# Dynamo graph Bulk_Upgrade.dyn (Dynamo 2.12.0.5650)
# packages: Rhythm 2022.1.1

directory_path = Directory("C:\Users\peter\Dropbox\Revit\Po-RVT\Russian Revit Stuff - Copy\03_Doors\01_Single Panel")
directory_from_path = DirectoryObject(path=directory_path)
code_block = CodeBlock { "*.rfa"; true; }
getDirectoryContents = FileSystem.GetDirectoryContents(directory=directory_from_path, searchString=code_block.out0, includeSubdirectories=code_block.out1)
code_block_2 = CodeBlock { true; }
ʳʰʸᵗʰᵐ_applications = Rhythm.Revit.Application.Applications.OpenDocumentFile(filePath=getDirectoryContents.files, closeAllWorksets=code_block_2)
code_block_3 = CodeBlock { true; }
ʳʰʸᵗʰᵐ_applications_2 = Rhythm.Revit.Application.Applications.CloseDocument(document=ʳʰʸᵗʰᵐ_applications, save=code_block_3)
