# Dynamo graph Detail_Lines_From_CAD_Link.dyn (Dynamo 2.13.1.3887)
# packages: bimorphNodes 4.2.1

select_model_elements = DSModelElementsSelection()  # 1 picked in the model
views = Views("TYP. PLANTER DETAIL")
detailCurvesFromCADLayers = CAD.DetailCurvesFromCADLayers(importInstance=select_model_elements, view=views)
