# Dynamo graph change_family_type_complete.dyn (Dynamo 2.16.1.2727)
# packages: archi-lab.net 2022.210.2522

categories = Categories("OST_Columns")  # graph input
byCategory = archilab.Revit.Selection.Select.ByCategory(category=categories)
code_block = CodeBlock { "Family"; }
categories_2 = Categories("OST_Columns")  # graph input
all_family_types_of_category = Custom[All Family Types Of Category](category=categories_2)  # Gets all family types/symbols of a given category in the model.
code_block_2 = CodeBlock { 0; }
getItemAtIndex = List.GetItemAtIndex(list=all_family_types_of_category@L3, index=code_block_2)
setParameterByName = Element.SetParameterByName(element=byCategory, parameterName=code_block, value=getItemAtIndex)
